# Grasshopper definition 210701_compas_path_plan.gh (Grasshopper 1.0.7)

number_slider = Slider(5, range=0..44)
panel = Panel("fix 22")
crv = Curve([<curve referenced from the Rhino model> x45])
data = Data(crv)

# ---- group: profile
# 1.3125" (33.3mm) section.
# this dist is to corner
panel_2 = Panel("4")
panel_3 = Panel("0.0333375")
division = Division(A=panel_3, B="sqrt(2)")
polygon = Polygon(Plane=PlaneXY(0, 0, 0), Radius=division, Segments=panel_2, FilletRadius=0)  # -> Polygon, Length
rotate = Rotate(Geometry=polygon.Polygon, Angle=degrees("45"), Plane=PlaneXY(0, 0, 0))  # -> Geometry, Transform

# ----
pt = Point([<point referenced from the Rhino model> x16])
sph = Sphere(Base=pt, Radius="0.040")

panel_4 = Panel("approach planes offsets")
num = Number(Slider(0.35, range=0..1))
num_2 = Number(Slider(0.6, range=0..1))

num_3 = Number(number_slider)
dom = ConstructDomain(DomainStart="0", DomainEnd=num_3)
range = Range(Domain=dom, Steps=num_3)
item = ListItem(List=data, Index=range, Wrap=True)
panel_5 = Panel("0.040")
len = Length(Curve=item)
midpt = CurveMiddle(Curve=item)
pframes = PerpFrames(Curve=item, Count="1", Align=True)  # -> Frames, Parameters
panel_6 = Panel("0.020")
orient = Orient(Geometry=rotate.Geometry, Source=PlaneXY(0, 0, 0), Target=simplify(pframes.Frames))  # -> Geometry, Transform
python = GhPythonScript(radius=panel_5, offset=panel_6, len=len)  # -> z_factor; inputs len: list
# ---------- python: Python ----------
len_reduce = (radius + offset)*2

z_factor = [(l - len_reduce)/l for l in len]
# ---------- end python ----------
pl = PlaneNormal(Origin=midpt, ZAxis=item)
graft = GraftTree(Tree=item, IncludeEmptyLists=True, IncludeNullItems=True)
swp1 = Sweep1(Rail=graft, Sections=orient.Geometry, Miter=1)
scale_nu = ScaleNU(Geometry=simplify(swp1), Plane=simplify(graft(pl)), ScaleX=1, ScaleY=1, ScaleZ=simplify(graft(python)))  # -> Geometry, Transform

# ----
# close circle
# far circle
panel_7 = Panel(num)  # disabled
panel_8 = Panel(num_2)  # disabled
panel_9 = Panel("15")  # disabled
item_2 = ListItem(List=data, Index=number_slider, Wrap=True)  # disabled
midpt_2 = CurveMiddle(Curve=item_2)  # disabled
number_slider_2 = Slider(4, range=0..15)  # disabled
circle = CircleCNR(Center=midpt_2, Normal=item_2, Radius=panel_7)  # disabled
circle_2 = CircleCNR(Center=midpt_2, Normal=item_2, Radius=panel_8)  # disabled
divide = DivideCurve(Curve=circle, Count=panel_9, Kinks=False)  # -> Points, Tangents, Parameters; disabled
divide_2 = DivideCurve(Curve=circle_2, Count=panel_9, Kinks=False)  # -> Points, Tangents, Parameters; disabled
pl_2 = ConstructPlane(Origin=divide.Points, XAxis=item_2, YAxis=divide.Tangents)  # disabled
pl_3 = ConstructPlane(Origin=divide_2.Points, XAxis=item_2, YAxis=divide_2.Tangents)  # disabled
num_4 = Number(number_slider_2)  # disabled
num_5 = Number(number_slider_2)  # disabled
item_3 = ListItem(List=pl_2, Index=num_4, Wrap=True)  # disabled
item_4 = ListItem(List=pl_3, Index=num_5, Wrap=True)  # disabled

panel_10 = Panel(panel_3)
panel_11 = Panel(panel_3)
multiplication = Multiplication(A=len, B=python)
box = CenterBox(Base=PlaneXY(0, 0, 0), X=expr("x/2", multiplication), Y=expr("x/2", panel_10), Z=expr("x/2", panel_11))

item_5 = ListItem(List=pl, Index=number_slider, Wrap=True)  # disabled
item_6 = ListItem(List=flatten(scale_nu.Geometry), Index=number_slider, Wrap=True)  # disabled
deplane = DeconstructPlane(Plane=item_5)  # -> Origin, XAxis, YAxis, ZAxis; disabled
deplane_2 = DeconstructPlane(Plane=item_3)  # -> Origin, XAxis, YAxis, ZAxis; disabled
xprod = CrossProduct(VectorA=deplane.XAxis, VectorB=deplane_2.ZAxis, Unitize=True)  # -> Vector, Length; disabled
angle = Angle(VectorA=deplane_2.ZAxis, VectorB=deplane.XAxis)  # -> Angle, Reflex; disabled
dprod = DotProduct(VectorA=deplane.XAxis, VectorB=deplane_2.ZAxis, Unitize=True)  # disabled
dprod_2 = DotProduct(VectorA=xprod.Vector, VectorB=deplane.ZAxis, Unitize=False)  # disabled
python_2 = GhPythonScript(dot=dprod, cross_dot=dprod_2, a=angle.Angle)  # -> out, a; disabled
# ---------- python_2: Python ----------
if dot > 0 and cross_dot > 0:
    a = a
elif dot < 0 and cross_dot > 0:
    a = a
elif dot < 0 and cross_dot < 0:
    a = -a
elif dot > 0 and cross_dot < 0:
    a = -a
# ---------- end python_2 ----------
rot3d = Rotate3D(Geometry=item_6, Angle=python_2.a, Center=deplane.Origin, Axis=deplane.ZAxis)  # -> Geometry, Transform; disabled
rotation_angle = Panel(python_2.a)  # disabled
preview = CustomPreview(
    Geometry=rot3d.Geometry,
    Material={diffuse=RGB(221, 160, 221), emission=RGB(66, 48, 66), shine=0.5, specular=RGB(255, 255, 255), transparency=0})  # disabled

addition = Addition(A="0.040", B="0.020")
panel_12 = Panel(len)
multiplication_2 = Multiplication(A=addition, B=2)
subtraction = Subtraction(A=panel_12, B=multiplication_2)
panel_13 = Panel(subtraction)
multiplication_3 = Multiplication(A=panel_13, B=1000)
panel_14 = Panel(multiplication_3)

# ---- group: lacing wobj
pln = Plane()  # disabled
pln_2 = Plane()  # disabled
python_3 = GhPythonScript()  # -> out, t_a; disabled
# ---------- python_3: Python ----------
from compas.geometry import Frame
from compas.geometry import Point
from compas_ghpython import draw_frame
from compas.geometry import Transformation

from compas_rhino.geometry import RhinoPlane


wobj_A = Frame.from_quaternion([0.999987, 0.002274, -0.001300, 0.004463])
wobj_A.point = [2239.98, 1816.570, 150.477]

f_a = RhinoPlane.from_geometry(wobj_A).to_compas() 
print(f_a)

t_a = Transformation.from_frame(f_a)
print t_a
# ---------- end python_3 ----------
python_4 = GhPythonScript(p_send1=pln_2, p_send2=pln, t_a=python_3.t_a)  # -> out, f_send_trans1, f_send_trans2; inputs p_send1: Plane; disabled
# ---------- python_4: Python ----------
from compas.geometry import Frame
from compas.geometry import Point
from compas_ghpython import draw_frame
from compas.geometry import Transformation

from compas_rhino.geometry import RhinoPlane

f_send1 = RhinoPlane.from_geometry(p_send1).to_compas() 
f_send2 = RhinoPlane.from_geometry(p_send2).to_compas() 

p_trans1 = f_send1.transformed(t_a.inverse())
p_trans2 = f_send2.transformed(t_a.inverse())

f_send_trans1 = draw_frame(p_trans1)
f_send_trans2 = draw_frame(p_trans2)
# ---------- end python_4 ----------
pln_3 = Plane(python_4.f_send_trans1)  # disabled
pln_4 = Plane(python_4.f_send_trans2)  # disabled

# ----
panel_15 = Panel("22 is messed up")
panel_16 = Panel("""0
pi
pi/2
-0.20944
-1.884956
2.722714
-0.20944
-1.884956
-1.466077
0.20944
-1.884956
1.884956
1.047198
Pi
-0.20944
-1.884956
-2.722714
0.20944
2.722714
2.722714
-1.047198
Pi
-1.047198 + pi/2
2.303835
-1.466077
-2.722714
-Pi
-0.20944
-1.466077
-1.884956
Pi
-1.884956
2.303835
-1.884956
-0.20944
0.628319
0.628319
2.303835
1.466077
1.466077
1.884956
1.884956
-0.20944
-1.466077
-1.466077""")
item_7 = ListItem(List=panel_16, Index=range, Wrap=True)

mesh = Mesh(box)

panel_17 = Panel(number_slider)
rot3d_2 = Rotate3D(Geometry=simplify(graft(pl)), Angle=simplify(graft(item_7)), Center=simplify(graft(midpt)), Axis=simplify(graft(item)))  # -> Geometry, Transform
rot3d_3 = Rotate3D(
    Geometry=simplify(graft(scale_nu.Geometry)),
    Angle=simplify(graft(item_7)),
    Center=simplify(graft(midpt)),
    Axis=simplify(graft(item)))  # -> Geometry, Transform
item_8 = ListItem(List=flatten(rot3d_2.Geometry), Index=panel_17, Wrap=True)
item_9 = ListItem(List=flatten(rot3d_3.Geometry), Index=panel_17, Wrap=True)
item_10 = ListItem(List=flatten(mesh), Index=panel_17, Wrap=True)

panel_18 = Panel(num)
panel_19 = Panel(num_2)
deplane_3 = DeconstructPlane(Plane=item_8)  # -> Origin, XAxis, YAxis, ZAxis
multiplication_4 = Multiplication(A=deplane_3.XAxis, B=panel_18)
multiplication_5 = Multiplication(A=deplane_3.XAxis, B=panel_19)
move = Move(Geometry=deplane_3.Origin, Motion=expr("-x", multiplication_4))  # -> Geometry, Transform
move_2 = Move(Geometry=deplane_3.Origin, Motion=expr("-x", multiplication_5))  # -> Geometry, Transform
multiplication_6 = Multiplication(A=move.Geometry, B=1000)
multiplication_7 = Multiplication(A=move_2.Geometry, B=1000)
pl_4 = ConstructPlane(Origin=multiplication_6, XAxis=deplane_3.YAxis, YAxis=deplane_3.ZAxis)
pl_5 = ConstructPlane(Origin=move.Geometry, XAxis=deplane_3.YAxis, YAxis=deplane_3.ZAxis)
pl_6 = ConstructPlane(Origin=multiplication_7, XAxis=deplane_3.YAxis, YAxis=deplane_3.ZAxis)
pl_7 = ConstructPlane(Origin=move_2.Geometry, XAxis=deplane_3.YAxis, YAxis=deplane_3.ZAxis)

panel_20 = Panel("5000")

# ----
# R2 PICKUP PLANES
panel_21 = Panel("3246.00")
panel_22 = Panel("1836.5")
pt_2 = ConstructPoint(XCoordinate=panel_21, YCoordinate="1000", ZCoordinate="733.4")
X = UnitX(Factor=1)
Y = UnitY(Factor=1)
division_2 = Division(A=pt_2, B=1000)
pl_8 = ConstructPlane(Origin=division_2, XAxis=expr("-x", X), YAxis=Y)
pl_9 = ConstructPlane(Origin=pt_2, XAxis=expr("-x", X), YAxis=Y)
move_3 = Move(Geometry=pl_8, Motion=Vector(0, 0, 0.5))  # -> Geometry, Transform
move_4 = Move(Geometry=pl_9, Motion=Vector(0, 0, 450))  # -> Geometry, Transform
pln_5 = Plane(move_3.Geometry)
pln_6 = Plane(pl_9)
pln_7 = Plane(pl_8)
pln_8 = Plane(move_4.Geometry)

# ----
# R1 - PICKUP PLANES
panel_23 = Panel("3246.00")
pt_3 = ConstructPoint(XCoordinate=panel_23, YCoordinate="1838.30", ZCoordinate="729.6")
X_2 = UnitX(Factor=1)
Y_2 = UnitY(Factor=1)
division_3 = Division(A=pt_3, B=1000)
pl_10 = ConstructPlane(Origin=division_3, XAxis=expr("-x", X_2), YAxis=Y_2)
pl_11 = ConstructPlane(Origin=pt_3, XAxis=expr("-x", X_2), YAxis=Y_2)
move_5 = Move(Geometry=pl_10, Motion=Vector(0, 0, 0.5))  # -> Geometry, Transform
move_6 = Move(Geometry=pl_11, Motion=Vector(0, 0, 450))  # -> Geometry, Transform
pln_9 = Plane(move_5.Geometry)
pln_10 = Plane(pl_10)
pln_11 = Plane(move_6.Geometry)
pln_12 = Plane(pl_11)

mesh_2 = Mesh(flatten(sph))

# ----
# VIZUALIZE
pln_13 = Plane(pl_5)
pln_14 = Plane(pl_7)
pln_15 = Plane(pln_5)
pln_16 = Plane(pln_7)
mesh_3 = Mesh(flatten(rot3d_3.Geometry))
pln_17 = Plane(pln_9)
pln_18 = Plane(pln_10)
mesh_4 = Mesh(flatten(item_9))
merge = Merge(Data1=pln_13, Data2=pln_14)
merge_2 = Merge(Data1=pln_17, Data2=pln_18, Data3=pln_15, Data4=pln_16)
shift = ShiftList(List=mesh_3, Shift=-1, Wrap=False)
preview_2 = CustomPreview(Geometry=mesh_2, Material=ColourSwatch(SwatchColor=RGB(112, 129, 255)))
preview_3 = CustomPreview(Geometry=mesh_4, Material=ColourSwatch(SwatchColor=RGB(4, 0, 255)))
preview_4 = CustomPreview(Geometry=shift, Material=ColourSwatch(SwatchColor=RGB(124, 125, 59)))
preview_5 = CustomPreview(
    Geometry=merge_2,
    Material={diffuse=RGB(0, 238, 255), emission=RGB(0, 71, 76), shine=0.5, specular=RGB(255, 255, 255), transparency=0})
preview_6 = CustomPreview(Geometry=merge, Material=ColourSwatch(SwatchColor=RGB(4, 0, 255)))

# ----
# If axis is included then allow the robot to move along track
toggle = BooleanToggle(True)
ros = ROSConnect(connect=Toggle(True))  # -> ros_client, is_connected; inputs port: Int32, connect: Boolean
#   port ip: The ip address ROS. Defaults to 127.0.0.1.
#   port port: The port of ROS. Defaults to 9090.
#   port connect: If True, connects to ROS. If False, disconnects from ROS. Defaults to False.
#   port ros_client: The ROS client.
#   port is_connected: True if connection established.
# ---------- ros: Python ----------
"""
Connect or disconnect to ROS.

COMPAS FAB v0.19.1
"""
from ghpythonlib.componentbase import executingcomponent as component
from scriptcontext import sticky as st

from compas_fab.backends import RosClient
from compas_fab.ghpython.components import create_id


class ROSConnect(component):
    def RunScript(self, ip, port, connect):
        ros_client = None

        ip = ip or '127.0.0.1'
        port = port or 9090

        key = create_id(self, 'ros_client')
        ros_client = st.get(key, None)

        if ros_client:
            st[key].close()
        if connect:
            st[key] = RosClient(ip, port)
            st[key].run(5)

        ros_client = st.get(key, None)
        is_connected = ros_client.is_connected if ros_client else False
        return (ros_client, is_connected)
# ---------- end ros ----------
data_2 = Data(ros.ros_client)
robot = ROSRobot(ros_client=data_2, load=toggle)  # -> robot; inputs load: Boolean
#   port ros_client: The ROS client.
#   port load: If True, loads the robot from ROS. Defaults to False.
# ---------- robot: Python ----------
"""
Load robot directly from ROS.

COMPAS FAB v0.19.1
"""
from compas_ghpython.artists import RobotModelArtist
from ghpythonlib.componentbase import executingcomponent as component
from scriptcontext import sticky as st

from compas_fab.ghpython.components import create_id


class ROSRobot(component):
    def RunScript(self, ros_client, load):
        key = create_id(self, 'robot')

        if ros_client and ros_client.is_connected and load:
            # Load URDF from ROS
            st[key] = ros_client.load_robot(load_geometry=True, precision='12f')
            st[key].artist = RobotModelArtist(st[key].model)

        robot = st.get(key, None)
        if robot:  # client sometimes need to be restarted, without needing to reload geometry
            robot.client = ros_client
        return robot
# ---------- end robot ----------
list = ValueList({"Robot 1": "robot1", "Robot 2": "robot2", "Robot 1 axis": "robot1_axis", "Robot 2 axis": "robot2_axis", "Robot 1 axis gripper": "robot1_axis_gripper", "Robot 2 axis gripper": "robot2_axis_gripper"}, selected="Robot 1 axis")
list_2 = ValueList({"Robot 1": "robot1", "Robot 2": "robot2", "Robot 1 axis": "robot1_axis", "Robot 2 axis": "robot2_axis", "Robot 1 axis gripper": "robot1_axis_gripper", "Robot 2 axis gripper": "robot2_axis_gripper"}, selected="Robot 2 axis")
data_3 = Data(list)
data_4 = Data(list_2)
data_5 = Data(robot)
data_6 = Data(data_3)

# ----
# R2 (Right)
# this track value is changed if "axis" group is used, otherwise it is fixed
pln_19 = Plane(pln_5)
python_5 = GhPythonScript(robot=data_5, group=data_4, base_position=Slider(2.7, range=0..3.9))  # -> out, config
# ---------- python_5: Python ----------
config = robot.zero_configuration()

print group[5]

#only do this if track not being used (fixed base)
if group in ("robotA", "robotB"):
    print "not using track"
    base_joint_name = group[5] + '_cart_joint'
    config[base_joint_name] = base_position
    print config

else:
    print "using track"
    config = None
# ---------- end python_5 ----------
ik = InverseKinematics(robot=data_5, plane=pln_19, start_configuration=python_5.config, group=data_4)  # -> configuration
#   port plane: The plane or frame to calculate the inverse kinematic for.
#   port start_configuration: If passed, calculates the inverse such that the joint positions differ the least from the start_configuration. Defaults to the zero configuration.
#   port group: The planning group used for calculation. Defaults to the robot's main planning group.
#   port configuration: The planning group's configuration.
# ---------- ik: Python ----------
"""
Calculate the robot's inverse kinematic for a given plane.

COMPAS FAB v0.19.1
"""
from ghpythonlib.componentbase import executingcomponent as component

from compas_fab.ghpython.components import coerce_frame


class InverseKinematics(component):
    def RunScript(self, robot, plane, start_configuration, group):
        configuration = None
        if robot and robot.client and robot.client.is_connected and plane:
            frame = coerce_frame(plane)
            configuration = robot.inverse_kinematics(frame, start_configuration, group)
        return configuration
# ---------- end ik ----------
python_6 = GhPythonScript(robot=data_5, group=data_4, start_config=python_5.config, group_config=ik)  # -> out, config
# ---------- python_6: Python ----------
config = robot.merge_group_with_full_configuration(group_config, start_config, group)

zero_config = robot.zero_configuration()
print zero_config

print start_config
print group_config

print(config)
# ---------- end python_6 ----------

# ----
# R1 (Left)
# this track value is changed if "axis" group is used, otherwise it is fixed
pln_20 = Plane(pln_9)
python_7 = GhPythonScript(robot=data_5, group=data_3, base_position=Slider(1.1, range=0..3.9))  # -> out, config; same code as python_5
ik_2 = InverseKinematics(robot=data_5, plane=pln_20, start_configuration=python_7.config, group=data_3)  # -> configuration; same code as ik
python_8 = GhPythonScript(robot=data_5, group=data_3, start_config=python_7.config, group_config=ik_2)  # -> out, config
# ---------- python_8: Python ----------
#zero_config = robot.zero_configuration()
#print zero_config
#
#print group_config
#print start_config


config = robot.merge_group_with_full_configuration(group_config, start_config, group)
print(config)
# ---------- end python_8 ----------

python_9 = GhPythonScript(robot=data_5, reset=Button())  # -> out, a
# ---------- python_9: Python ----------
print robot.info()

print robot.get_configurable_joint_names()
print robot.zero_configuration()
# ---------- end python_9 ----------
panel_24 = Panel(python_9.out)
python_10 = GhPythonScript(robot=data_5, config1=python_8.config, config2=python_6.config)  # -> out, merged_config
# ---------- python_10: Python ----------
merged_config = robot.zero_configuration().merged(config2)

#manually enter in Rob B joints in full config
merged_config['r1_cart_joint'] = config1['r1_cart_joint']
merged_config['r1_joint_1'] = config1['r1_joint_1']
merged_config['r1_joint_2'] = config1['r1_joint_2']
merged_config['r1_joint_3'] = config1['r1_joint_3']
merged_config['r1_joint_4'] = config1['r1_joint_4']
merged_config['r1_joint_5'] = config1['r1_joint_5']
merged_config['r1_joint_6'] = config1['r1_joint_6']

print merged_config
print config2['r2_cart_joint']
print config1['r1_cart_joint']
# ---------- end python_10 ----------
robot_visualize = RobotVisualize(robot=data_5, configuration=python_10.merged_config)  # -> visual, collision, attached_meshes, frames, base_frame, ee_frame; inputs attached_collision_meshes: list, show_visual: Boolean, show_collision: Boolean, show_frames: Boolean, show_base_frame: Boolean, show_end_effector_frame: Boolean, show_acm: Boolean
#   port group: The planning group used for end-effector and base visualization.
#   port configuration: The robot's full configuration.
#   port attached_collision_meshes: A list of attached collision meshes.
#   port show_visual: Whether or not to show the robot's visual meshes.
#   port show_collision: Whether or not to show the robot's collision meshes.
#   port show_frames: Whether or not to show the robot's joint frames.
#   port show_base_frame: Whether or not to show the robot's base frame.
#   port show_end_effector_frame: Whether or not to show the robot's end-effector frame.
#   port show_acm: Whether or not to show the attached collision meshes (if any).
#   port visual: The robot's visual Rhino meshes (if any).
#   port collision: The robot's collision Rhino meshes (if any).
#   port attached_meshes: The attached collision Rhino meshes (if any).
#   port frames: The robot's joint frames as Rhino planes (if any).
#   port base_frame: The robot's base frame as a Rhino plane (if any).
#   port ee_frame: The robot's end-effector frame as a Rhino plane (if any).
# ---------- robot_visualize: Python ----------
"""
Visualizes the robot.

COMPAS FAB v0.19.1
"""
from compas.geometry import Frame
from compas.geometry import Transformation
from compas_ghpython.artists import FrameArtist
from compas_ghpython.artists import MeshArtist
from ghpythonlib.componentbase import executingcomponent as component


class RobotVisualize(component):
    def RunScript(self, robot, group, configuration, attached_collision_meshes, show_visual, show_collision,
                  show_frames, show_base_frame, show_end_effector_frame, show_acm):

        visual = None
        collision = None
        attached_meshes = None
        frames = None
        base_frame = None
        ee_frame = None

        if robot:
            show_visual = True if show_visual is None else show_visual
            configuration = configuration or robot.zero_configuration()

            robot.update(configuration, visual=show_visual, collision=show_collision)
            compas_frames = robot.transformed_frames(configuration, group)

            if show_visual:
                visual = robot.artist.draw_visual()

            if show_collision:
                collision = robot.artist.draw_collision()

            if show_base_frame:
                base_compas_frame = compas_frames[0]
                artist = FrameArtist(base_compas_frame)
                base_frame = artist.draw()

            if show_end_effector_frame:
                ee_compas_frame = robot.forward_kinematics(configuration, group, options=dict(solver='model'))
                artist = FrameArtist(ee_compas_frame)
                ee_frame = artist.draw()

            if show_frames:
                frames = []
                for compas_frame in compas_frames[1:]:
                    artist = FrameArtist(compas_frame)
                    frame = artist.draw()
                    frames.append(frame)

            if show_acm:
                attached_meshes = []
                for acm in attached_collision_meshes:
                    frame = robot.forward_kinematics(configuration, options=dict(solver='model', link_name=acm.link_name))
                    T = Transformation.from_frame_to_frame(Frame.worldXY(), frame)
                    mesh = acm.collision_mesh.mesh.transformed(T)
                    attached_meshes.append(MeshArtist(mesh).draw())

        return (visual, collision, attached_meshes, frames, base_frame, ee_frame)
# ---------- end robot_visualize ----------

pln_21 = Plane(pln_11)
pln_22 = Plane(pln_12)
pln_23 = Plane(pln_8)
pln_24 = Plane(pln_6)
merge_3 = Merge(Data1=pln_21, Data2=pln_22)
python_11 = GhPythonScript()  # -> t_a
# ---------- python_11: Python ----------
from compas.geometry import Frame
from compas.geometry import Point
from compas_ghpython import draw_frame
from compas.geometry import Transformation

from compas_rhino.geometry import RhinoPlane

wobj_A = Frame.from_quaternion([0.999964,0.00426176,-0.00158504,-0.00717332])
wobj_A.point = [-681.039,1564.71,817.284]

f_a = RhinoPlane.from_geometry(wobj_A).to_compas() 
print(f_a)

t_a = Transformation.from_frame(f_a)
print t_a
# ---------- end python_11 ----------
merge_4 = Merge(Data1=pln_23, Data2=pln_24)
python_12 = GhPythonScript(p_send=merge_3, t_a=python_11)  # -> f_send; inputs p_send: list
# ---------- python_12: Python ----------
from compas.geometry import Frame
from compas_ghpython import draw_frame
from compas_rhino.geometry import RhinoPlane
#
f_send = []
for p in p_send:
    f = RhinoPlane.from_geometry(p).to_compas()
    f_trans = f.transformed(t_a.inverse())
    f_send.append(f_trans)
    
print f_send
# ---------- end python_12 ----------
python_13 = GhPythonScript(p_send=merge_4, t_a=python_11)  # -> f_send; inputs p_send: list; same code as python_12

pln_25 = Plane(pl_6)
pln_26 = Plane(pl_4)
merge_5 = Merge(Data1=pln_25, Data2=pln_26)
python_14 = GhPythonScript()  # -> t_a; same code as python_11
python_15 = GhPythonScript(p_send=merge_5, t_a=python_14)  # -> f_send; inputs p_send: list
# ---------- python_15: Python ----------
from compas.geometry import Frame
from compas_ghpython import draw_frame
from compas_rhino.geometry import RhinoPlane

f_send = []
for p in p_send:
    f = RhinoPlane.from_geometry(p).to_compas()
    f_trans = f.transformed(t_a.inverse())
    f_send.append(f_trans)
    
print f_send
# ---------- end python_15 ----------

panel_25 = Panel("approach")
panel_26 = Panel("place")
pln_27 = Plane(pl_7)
pln_28 = Plane(pl_5)

data_7 = Data(python_12)
data_8 = Data(python_13)
data_9 = Data(python_15)

list_3 = ValueList({"robot_1": 1, "robot_2": 2}, selected="robot_1")
list_4 = ValueList({"platform": "ecl_platform", "world": "ecl_zero", "wobj_1": "r1B_acadia_back_EBIT_01", "wobj_2": "r2A_acadia_back_EBIT_01"}, selected="wobj_1")
data_10 = Data(data_2)
python_16 = GhPythonScript(
    ros=data_10,
    rob_num=list_3,
    wobj=list_4,
    pick_r1=data_7,
    pick_r2=data_8,
    place=data_9,
    send_pick=Button(),
    send_place=Button(),
    send_place2=Button())  # -> out, a; inputs rob_num: Int32, pick_r1: list, pick_r2: list, place: list
# ---------- python_16: Python ----------
import compas_rrc as rrc
from compas.geometry import Frame
from compas.geometry import Plane

from compas_rhino.geometry import RhinoPlane


# Create ABB Client (rob2 = A = right, rob1 = B = left)
if rob_num == 1:
    abb = rrc.AbbClient(ros, '/rob1')
    abb.send(rrc.SetTool('ecl_pneumatic_gripper'))
    DO = 'do_1'
    pick = pick_r1
    print('Connected.')
elif rob_num == 2:
    abb = rrc.AbbClient(ros, '/rob2')
    abb.send(rrc.SetTool('ecl_pneumatic_gripper'))
    DO = 'do_2'
    pick = pick_r2
    print('Connected.')


# Define speeds
speed = 100

# set wobj
abb.send(rrc.SetWorkObject(wobj))


if send_pick:
    
    #abb.send(rrc.SetWorkObject(wobj))
    
    #open gripper
    done = abb.send_and_wait(rrc.SetDigital(DO,0), timeout = 10)
    
    for f in pick:
        done = abb.send_and_wait(rrc.MoveToFrame(f, speed, rrc.Zone.FINE), timeout = 30)
        future = abb.send(rrc.Stop(feedback_level=rrc.FeedbackLevel.DONE))
        
    #close gripper
    done = abb.send_and_wait(rrc.SetDigital(DO,1), timeout = 10)
    
    #back to start frame
    done = abb.send_and_wait(rrc.MoveToFrame(pick[0], speed, rrc.Zone.FINE), timeout = 30)
    future = abb.send(rrc.Stop(feedback_level=rrc.FeedbackLevel.DONE))
    
    print('Finished')
    
    
if send_place:
    
    for f in place:
        done = abb.send_and_wait(rrc.MoveToFrame(f, speed, rrc.Zone.FINE), timeout = 30)
        future = abb.send(rrc.Stop(feedback_level=rrc.FeedbackLevel.DONE))
        
    print('Finished')
    
    
if send_place2:
    
    # Get frame and external axes
    frame, external_axes = abb.send_and_wait(rrc.GetRobtarget(), timeout = 10)
    
    x_frame = frame.point[0]
    x_target = place[0].point.x
    
    diff = x_target - x_frame
    
    external_axis = rrc.ExternalAxes(external_axes.values[0] - 0.7*diff)
    
    frame.point[0] += diff
    
    done = abb.send_and_wait(rrc.MoveToRobtarget(frame, external_axis, speed, rrc.Zone.FINE),timeout = 30)
    future = abb.send(rrc.Stop(feedback_level=rrc.FeedbackLevel.DONE)) 
    
    print('Finished')
# ---------- end python_16 ----------

plan_cartesian_motion = PlanCartesianMotion(planes=pln_28)  # -> trajectory; inputs planes: list, attached_collision_meshes: list, path_constraints: list, compute: Boolean
#   port planes: The planes or frames through which the path is defined.
#   port start_configuration: The robot's full configuration, i.e. values for all configurable joints of the entire robot, at the starting position. Defaults to the all-zero configuration.
#   port group: The planning group used for calculation. Defaults to the robot's main planning group.
#   port attached_collision_meshes: A list of attached collision meshes to be included for planning.
#   port path_constraints: Optional constraints that can be imposed along the solution path. Note that path calculation won't work if the start_configuration violates these constraints. Defaults to None.
#   port max_step: The approximate distance between the calculated points. (Defined in the robot's units.) Defaults to 0.01.
#   port compute: If True, calculates a trajectory.
#   port trajectory: The calculated trajectory.
# ---------- plan_cartesian_motion: Python ----------
"""
Calculate a cartesian motion path (linear in tool space).

COMPAS FAB v0.19.1
"""
from ghpythonlib.componentbase import executingcomponent as component
from scriptcontext import sticky as st

from compas_fab.ghpython.components import coerce_frame
from compas_fab.ghpython.components import create_id


class PlanCartesianMotion(component):
    def RunScript(self, robot, planes, start_configuration, group, attached_collision_meshes, path_constraints, max_step, compute):

        key = create_id(self, 'trajectory')

        max_step = float(max_step) if max_step else 0.01
        path_constraints = list(path_constraints) if path_constraints else None
        attached_collision_meshes = list(attached_collision_meshes) if attached_collision_meshes else None

        if robot and robot.client and robot.client.is_connected and start_configuration and planes and compute:
            frames = [coerce_frame(plane) for plane in planes]
            st[key] = robot.plan_cartesian_motion(frames,
                                                  start_configuration=start_configuration,
                                                  group=group,
                                                  options=dict(
                                                      max_step=max_step,
                                                      path_constraints=path_constraints,
                                                      attached_collision_meshes=attached_collision_meshes
                                                  ))

        trajectory = st.get(key, None)
        return trajectory
# ---------- end plan_cartesian_motion ----------

constraints_from_plane = ConstraintsFromPlane(robot=data_5, plane=pln_27, group=data_6)  # -> constraints
#   port plane: The plane or frame from which we create position and orientation constraints.
#   port group: The planning group for which we specify the constraint. Defaults to the robot's main planning group.
#   port tolerance_position: The allowed tolerance to the frame's position (defined in the robot's units). Defaults to 0.001
#   port tolerance_xaxis: The allowed tolerance of the frame's X-axis in degrees.
#   port tolerance_yaxis: The allowed tolerance of the frame's Y-axis in degrees.
#   port tolerance_zaxis: The allowed tolerance of the frame's Z-axis in degrees.
#   port constraints: A list containing a position and an orientation constraint.
# ---------- constraints_from_plane: Python ----------
"""
Create a position and an orientation constraint from a plane calculated for the group's end-effector link.

COMPAS FAB v0.19.1
"""
import math

from ghpythonlib.componentbase import executingcomponent as component

from compas_fab.ghpython.components import coerce_frame


class ConstraintsFromPlane(component):
    def RunScript(self, robot, plane, group, tolerance_position, tolerance_xaxis, tolerance_yaxis, tolerance_zaxis):
        goal_constraints = None
        if robot and plane:
            tolerance_position = tolerance_position or 0.001
            tolerance_xaxis = tolerance_xaxis or 1.
            tolerance_yaxis = tolerance_yaxis or 1.
            tolerance_zaxis = tolerance_zaxis or 1.

            frame = coerce_frame(plane)
            tolerances_axes = [math.radians(tolerance_xaxis), math.radians(tolerance_yaxis), math.radians(tolerance_zaxis)]
            goal_constraints = robot.constraints_from_frame(frame, tolerance_position, tolerances_axes, group)

        return goal_constraints
# ---------- end constraints_from_plane ----------
plan_motion = PlanMotion(
    robot=data_5,
    goal_constraints=constraints_from_plane,
    start_configuration=python_10.merged_config,
    group=data_6,
    compute=Button())  # -> trajectory; inputs goal_constraints: list, attached_collision_meshes: list of Mesh, path_constraints: list, compute: Boolean
#   port goal_constraints: The goal to be achieved, defined in a set of constraints. Constraints can be very specific, for example defining value domains for each joint, such that the goal configuration is included, or defining a volume in space, to which a specific robot link (e.g. the end-effector) is required to move to.
#   port start_configuration: The robot's full configuration, i.e. values for all configurable joints of the entire robot, at the starting position. Defaults to the all-zero configuration.
#   port group: The planning group used for calculation. Defaults to the robot's main planning group.
#   port attached_collision_meshes: A list of attached collision meshes to be included for planning.
#   port path_constraints: Optional constraints that can be imposed along the solution path. Note that path calculation won't work if the start_configuration violates these constraints. Defaults to None.
#   port planner_id: The name of the algorithm used for path planning. Defaults to 'RRTConnectkConfigDefault'
#   port compute: If True, calculates a trajectory.
#   port trajectory: The calculated trajectory.
# ---------- plan_motion: Python ----------
"""
Calculate a motion path.

COMPAS FAB v0.19.1
"""
from ghpythonlib.componentbase import executingcomponent as component
from scriptcontext import sticky as st

from compas_fab.ghpython.components import create_id


class PlanMotion(component):
    def RunScript(self, robot, goal_constraints, start_configuration, group, attached_collision_meshes, path_constraints, planner_id, compute):

        key = create_id(self, 'trajectory')

        path_constraints = list(path_constraints) if path_constraints else None
        attached_collision_meshes = list(attached_collision_meshes) if attached_collision_meshes else None
        planner_id = str(planner_id) if planner_id else 'RRTConnectkConfigDefault'

        if robot and robot.client and robot.client.is_connected and start_configuration and goal_constraints and compute:
            st[key] = robot.plan_motion(goal_constraints,
                                        start_configuration=start_configuration,
                                        group=group,
                                        options=dict(
                                            attached_collision_meshes=attached_collision_meshes,
                                            path_constraints=path_constraints,
                                            planner_id=planner_id,
                                        ))

        trajectory = st.get(key, None)
        return trajectory
# ---------- end plan_motion ----------
trajectory_visualize = TrajectoryVisualize(robot=data_5, group=data_6, trajectory=plan_motion)  # -> start_configuration, configurations, fraction, time, planes, P, V, A
#   port group: The planning group for which this trajectory was planned.
#   port trajectory: The calculated trajectory.
#   port start_configuration: The start configuration of the trajectory.
#   port configurations: The full configurations along the trajectory.
#   port fraction: Indicates the fraction of requested trajectory that was calculated, e.g. 1 means the full trajectory was found.
#   port time: The time which is needed to execute that trajectory at full speed.
#   port planes: The planes of the robot's end-effector.
#   port P: The positions along the trajectory
#   port V: The velocities along the trajectory
#   port A: The accelerations along the trajectory
# ---------- trajectory_visualize: Python ----------
"""
Visualizes a trajectory.

COMPAS FAB v0.19.1
"""
from compas_ghpython import draw_frame
from compas_ghpython import list_to_ghtree
from ghpythonlib.componentbase import executingcomponent as component


class TrajectoryVisualize(component):
    def RunScript(self, robot, group, trajectory):
        start_configuration = None
        configurations = []
        fraction = 0.
        time = 0.

        planes = []
        positions = []
        velocities = []
        accelerations = []

        if robot and trajectory:
            group = group or robot.main_group_name

            for c in trajectory.points:
                configurations.append(robot.merge_group_with_full_configuration(c, trajectory.start_configuration, group))
                frame = robot.forward_kinematics(c, group, options=dict(solver='model'))
                planes.append(draw_frame(frame))
                positions.append(c.positions)
                velocities.append(c.velocities)
                accelerations.append(c.accelerations)

            start_configuration = trajectory.start_configuration
            fraction = trajectory.fraction
            time = trajectory.time_from_start

        P = list_to_ghtree(list(zip(*positions)))
        V = list_to_ghtree(list(zip(*velocities)))
        A = list_to_ghtree(list(zip(*accelerations)))

        # return outputs if you have them; here I try it for you:
        return (start_configuration, configurations, fraction, time, planes, P, V, A)
# ---------- end trajectory_visualize ----------
item_11 = ListItem(List=trajectory_visualize.configurations, Index=Slider(17, range=0..50), Wrap=False)
robot_visualize_2 = RobotVisualize(robot=data_5, configuration=item_11)  # -> visual, collision, attached_meshes, frames, base_frame, ee_frame; inputs attached_collision_meshes: list, show_visual: Boolean, show_collision: Boolean, show_frames: Boolean, show_base_frame: Boolean, show_end_effector_frame: Boolean, show_acm: Boolean; same code as robot_visualize

mesh_5 = Mesh(robot_visualize_2.attached_meshes)

attach = BooleanToggle(False)  # disabled
cluster = Cluster()  # disabled
attach_2 = BooleanToggle(False)  # disabled
z_offset = Slider(0.3, range=-0.1..0.3)  # disabled

mesh_6 = Mesh(item_10)
scene = PlanningScene(robot=data_5)  # -> scene
#   port scene: A planning scene.
# ---------- scene: Python ----------
"""
Create a planning scene.

COMPAS FAB v0.19.1
"""
from ghpythonlib.componentbase import executingcomponent as component
from scriptcontext import sticky as st

from compas_fab.ghpython.components import create_id
from compas_fab.robots import PlanningScene


class PlanningSceneComponent(component):
    def RunScript(self, robot):
        key = create_id(self, 'planning_scene')
        if robot:
            st[key] = PlanningScene(robot)
        return st.get(key, None)
# ---------- end scene ----------
mesh_7 = Mesh(flatten(rot3d_3.Geometry))
mesh_8 = Mesh(item_10)
mesh_9 = Mesh(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)
acm = AttachedCollisionMesh(
    scene=scene,
    mesh=mesh_6,
    identifier="member",
    link_name="r1_tcp",
    touch_links="r1_gripper",
    add=Button(),
    remove=Button())  # -> attached_collision_mesh; inputs mesh: Mesh, touch_links: list, add: Boolean, remove: Boolean
#   port scene: The planning scene.
#   port mesh: A collision mesh.
#   port identifier: The identifier of the collision mesh.
#   port link_name: The robot's link name to attach the mesh to.
#   port touch_links: Names of links that the robot is allowed to touch.
#   port add: If True, adds the collision mesh to the planning scene.
#   port remove: If True, removes the collision mesh from the planning scene.
#   port attached_collision_mesh: A collision mesh that is attached to a robot's link.
# ---------- acm: Python ----------
"""
Add an attached collision mesh to the robot.

COMPAS FAB v0.19.1
"""
from ghpythonlib.componentbase import executingcomponent as component

from compas_rhino.geometry import RhinoMesh
from compas_fab.robots import AttachedCollisionMesh
from compas_fab.robots import CollisionMesh


class AttachedCollisionMeshComponent(component):
    def RunScript(self, scene, mesh, identifier, link_name, touch_links, add, remove):
        attached_collision_mesh = None
        if scene and mesh and identifier and link_name:
            compas_mesh = RhinoMesh.from_geometry(mesh).to_compas()
            collision_mesh = CollisionMesh(compas_mesh, identifier)
            attached_collision_mesh = AttachedCollisionMesh(collision_mesh, link_name, touch_links)
            if add:
                scene.add_attached_collision_mesh(attached_collision_mesh)
            if remove:
                scene.remove_attached_collision_mesh(identifier)
                scene.remove_collision_mesh(identifier)
        return attached_collision_mesh
# ---------- end acm ----------
acm_2 = AttachedCollisionMesh(
    scene=scene,
    mesh=mesh_8,
    identifier="member",
    link_name="r2_tcp",
    touch_links="r2_gripper",
    add=Button(),
    remove=Button())  # -> attached_collision_mesh; inputs mesh: Mesh, touch_links: list, add: Boolean, remove: Boolean; same code as acm
cm = CollisionMesh(scene=scene, mesh=mesh_9, identifier="base_mesh", add=Button(), remove=Button())  # -> ok; inputs mesh: Mesh, add: Boolean, remove: Boolean
#   port scene: The planning scene.
#   port mesh: A collision mesh.
#   port identifier: The identifier of the collision mesh.
#   port add: If True, adds the collision mesh to the planning scene.
#   port remove: If True, removes the collision mesh from the planning scene.
#   port ok: True if the operation was successfully performed.
# ---------- cm: Python ----------
"""
Add or remove a collision mesh from the planning scene.

COMPAS FAB v0.19.1
"""
from compas_rhino.geometry import RhinoMesh
from ghpythonlib.componentbase import executingcomponent as component

from compas_fab.robots import CollisionMesh


class CollisionMeshComponent(component):
    def RunScript(self, scene, M, name, add, remove):
        ok = False
        if scene and M and name:
            mesh = RhinoMesh.from_geometry(M).to_compas()
            collision_mesh = CollisionMesh(mesh, name)
            if add:
                scene.add_collision_mesh(collision_mesh)
                ok = True
            if remove:
                scene.remove_collision_mesh(name)
                ok = True
        return ok
# ---------- end cm ----------
panel_27 = Panel(cm)

shift_2 = ShiftList(List=flatten(mesh_7), Shift=-1, Wrap=False)

attach_tool = GhPythonScript(scene=scene, robot=robot, group=data_4, attached=attach, z_offset=z_offset, tool_mesh=cluster)  # -> tool_at_origin; inputs tool_mesh: Mesh; disabled
# ---------- attach_tool: Python ----------
import os
from compas.geometry import Frame
from compas.datastructures import Mesh
from compas_fab.robots import PlanningScene
from compas_fab.robots import Tool
from compas_ghpython.artists import MeshArtist
from compas_rhino.geometry import RhinoMesh

HERE = os.path.dirname(ghenv.Component.OnPingDocument().FilePath)

# create tool from mesh and frame
mesh = RhinoMesh.from_geometry(tool_mesh).to_compas()
frame = Frame([0, 0, z_offset], [1, 0, 0], [0, 1, 0])
tool = Tool(mesh, frame, name='gripper')
#tool_at_origin = MeshArtist(mesh).draw()

if robot and robot.client and robot.client.is_connected:
    scene = PlanningScene(robot)
    if attached:
        robot.attach_tool(tool,group)
        scene.add_attached_tool()
#        if group == 'robotAaxis':
#            print 'here'
#            robot.attach_tool(tool, group ='robotAaxis')
#            scene.add_attached_tool()
#        elif group == 'robotBaxis':
#            print 'here2'
#            robot.attach_tool(tool, group ='robotBaxis')
#            scene.add_attached_tool()
        
    else:
        if robot.attached_tool:
            scene.remove_attached_tool()
            scene.remove_collision_mesh('attached_tool_link_collision_0')
            robot.detach_tool()
# ---------- end attach_tool ----------
attach_tool_2 = GhPythonScript(scene=scene, robot=robot, group=data_3, attached=attach_2, z_offset=z_offset, tool_mesh=cluster)  # -> tool_at_origin; inputs tool_mesh: Mesh; disabled
# ---------- attach_tool_2: Python ----------
import os
from compas.geometry import Frame
from compas.datastructures import Mesh
from compas_fab.robots import PlanningScene
from compas_fab.robots import Tool
from compas_ghpython.artists import MeshArtist
from compas_rhino.geometry import RhinoMesh

HERE = os.path.dirname(ghenv.Component.OnPingDocument().FilePath)

# create tool from mesh and frame
mesh = RhinoMesh.from_geometry(tool_mesh).to_compas()
frame = Frame([0, 0, z_offset], [1, 0, 0], [0, 1, 0])
tool = Tool(mesh, frame, name='gripper')
#tool_at_origin = MeshArtist(mesh).draw()

if robot and robot.client and robot.client.is_connected:
    scene = PlanningScene(robot)
    if attached:
        robot.attach_tool(tool, group)
        scene.add_attached_tool()
#        if group == 'robotAaxis':
#            print 'here'
#            robot.attach_tool(tool, group ='robotAaxis')
#            scene.add_attached_tool()
#        elif group == 'robotBaxis':
#            print 'here2'
#            robot.attach_tool(tool, group ='robotBaxis')
#            scene.add_attached_tool()
        
    else:
        if robot.attached_tool:
            scene.remove_attached_tool()
            scene.remove_collision_mesh('attached_tool_link_collision_0')
            robot.detach_tool()
# ---------- end attach_tool_2 ----------

mjoin = MeshJoin(Meshes=shift_2)
cm_2 = CollisionMesh(scene=scene, mesh=simplify(mjoin), identifier="structure_mesh", add=Button(), remove=Button())  # -> ok; inputs mesh: Mesh, add: Boolean, remove: Boolean; same code as cm
panel_28 = Panel(cm_2)

mesh_10 = Mesh(attach_tool_2)  # disabled
mesh_11 = Mesh(attach_tool)  # disabled

# ==== cluster Cluster
mesh_detailed = Mesh([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])
bounding_box = BoundingBox(Content=mesh_detailed, Plane=PlaneXY(0, 0, 0))  # -> Box, Box_2
mesh_brep = MeshBrep(
    Brep=bounding_box.Box,
    Settings={GridMaxCount=16, GridMinCount=4, JaggedSeams=False, MaxEdgeLength=0, MinEdgeLength=0.0001, MinTolerance=0, Refine=True, RefineAngle=0, RelativeTolerance=0.65, SimplePlanes=True, Tolerance=0})
mesh_join = MeshJoin(Meshes=mesh_brep)
scale = Scale(Geometry=mesh_join, Center=Point(0, 0, 0), Factor="0.0008")  # -> Geometry, Transform
G = ClusterOutput(scale.Geometry)
